# Grasshopper definition ASmith_GameOfLifeSimple.gh (Grasshopper 1.0.7)

number_slider = Slider(500, range=0..500)
number_slider_2 = Slider(500, range=0..500)
number_slider_3 = Slider(0.01, range=0..0.01)
square = Square(Plane=PlaneXY(0, 0, 0), Size=Slider(0.1, range=0..0.1), ExtentX=number_slider_2, ExtentY=number_slider)  # -> Cells, Points
boundary_surfaces = BoundarySurfaces(Edges=square.Cells)
area = Area(Geometry=boundary_surfaces)  # -> Area, Centroid
curve = Curve(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)
point_in_curve = PointInCurve(Point=area.Centroid, Curve=curve)  # -> Relationship, Point
equality = Equality(FirstNumber=point_in_curve.Relationship, SecondNumber="2")  # -> Equality, Inequality
flatten_tree = FlattenTree(Tree=equality.Equality, Path="{0}")
flatten_tree_2 = FlattenTree(Tree=boundary_surfaces, Path="{0}")
panel = Panel("""2
3""")
trigger = Trigger(Interval=50, TimerInterval=50, Target=gameoflife_simple)  # disabled
gameoflife_simple = CSharpScript(
    cells=flatten_tree,
    rows=number_slider,
    columns=number_slider_2,
    birthRule="3",
    survivalRule=panel,
    run=Toggle(True),
    reset=Button())  # -> out, previous, newIteration, B; inputs cells: list of Boolean, rows: Int32, columns: Int32, birthRule: list of Int32, survivalRule: list of Int32, run: Boolean, reset: Boolean
# ---------- gameoflife_simple: C# ----------
    //Sanity
    if (run == false){
      return;
    }

    if (cells.Count != rows * columns){
      Component.AddRuntimeMessage(GH_RuntimeMessageLevel.Error, "Something wrong with dimensions of grid");
      return;
    }

    //Initialize calculations
    if (reset == true){
      //Turn the list of bools into a 2D array
      prevCells = new bool[columns, rows];
      int it = 0;
      for (int j = 0; j < columns; j++){
        for (int i = 0; i < rows; i++){
          prevCells[j, i] = cells[it];
          it++;
        }
      }
    }

    //New Array of Alive/Dead cells for next iteration
    int[,] nCount = new int[columns, rows];


    //Switch previous cells with new ones
    bool[,] newCells = new bool[columns, rows];

    for (int j = 0; j < columns; j++){
      for (int i = 0; i < rows; i++){

        //Compute alive neighbors
        int aliveNeighbors = 0;
        int ni, nj;

        //Top-Left (wrapping grid)
        ni = i + 1;
        nj = j - 1;
        if (ni > rows - 1) ni = 0;
        else if (ni < 0) ni = rows - 1;
        if (nj > columns - 1) nj = 0;
        else if (nj < 0) nj = columns - 1;
        if (prevCells[nj, ni] == true) aliveNeighbors++;

        //Top
        ni = i + 1;
        nj = j;
        if (ni > rows - 1) ni = 0;
        else if (ni < 0) ni = rows - 1;
        if (nj > columns - 1) nj = 0;
        else if (nj < 0) nj = columns - 1;
        if (prevCells[nj, ni] == true) aliveNeighbors++;

        //Top-Right
        ni = i + 1;
        nj = j + 1;
        if (ni > rows - 1) ni = 0;
        else if (ni < 0) ni = rows - 1;
        if (nj > columns - 1) nj = 0;
        else if (nj < 0) nj = columns - 1;
        if (prevCells[nj, ni] == true) aliveNeighbors++;

        //Left
        ni = i;
        nj = j - 1;
        if (ni > rows - 1) ni = 0;
        else if (ni < 0) ni = rows - 1;
        if (nj > columns - 1) nj = 0;
        else if (nj < 0) nj = columns - 1;
        if (prevCells[nj, ni] == true) aliveNeighbors++;

        //Right
        ni = i;
        nj = j + 1;
        if (ni > rows - 1) ni = 0;
        else if (ni < 0) ni = rows - 1;
        if (nj > columns - 1) nj = 0;
        else if (nj < 0) nj = columns - 1;
        if (prevCells[nj, ni] == true) aliveNeighbors++;

        //Bottom-Left
        ni = i - 1;
        nj = j - 1;
        if (ni > rows - 1) ni = 0;
        else if (ni < 0) ni = rows - 1;
        if (nj > columns - 1) nj = 0;
        else if (nj < 0) nj = columns - 1;
        if (prevCells[nj, ni] == true) aliveNeighbors++;

        //Bottom
        ni = i - 1;
        nj = j;
        if (ni > rows - 1) ni = 0;
        else if (ni < 0) ni = rows - 1;
        if (nj > columns - 1) nj = 0;
        else if (nj < 0) nj = columns - 1;
        if (prevCells[nj, ni] == true) aliveNeighbors++;

        //Bottom-Right
        ni = i - 1;
        nj = j + 1;
        if (ni > rows - 1) ni = 0;
        else if (ni < 0) ni = rows - 1;
        if (nj > columns - 1) nj = 0;
        else if (nj < 0) nj = columns - 1;
        if (prevCells[nj, ni] == true) aliveNeighbors++;

        Print("Alive Neighbors: " + aliveNeighbors);

        //Compute the new state
        bool previousState = prevCells[j, i];
        bool newState = false;

        // If cell was dead
        if (previousState == false){
          foreach (int b in birthRule){
            if (b == aliveNeighbors){
              newState = true;
              break;
            }
          }
        }
          // If cell was alive
        else {
          foreach (int s in survivalRule){
            if (s == aliveNeighbors){
              newState = true;
              break;
            }
          }
        }
        //Store new state in new array
        newCells[j, i] = newState;

      }
    }

    //Output
    previous = prevCells;
    newIteration = newCells;

    //Store new cells for next iteration
    prevCells = newCells;
# ---------- gameoflife_simple: C# additional code ----------
  //Create Persistant variables
  bool[,] prevCells;
# ---------- end gameoflife_simple ----------
cull_pattern = CullPattern(List=flatten_tree_2, CullPattern=gameoflife_simple.newIteration)
custom_preview = CustomPreview(Geometry=cull_pattern, Material=ColourSwatch(SwatchColor=RGB(0, 47, 166)))
